# Grasshopper definition parse.gh (Grasshopper 1.0.7)

panel = Panel("""Nube Puntos
Análisis Nube Puntos
Mesh Tridimensional
Datos GIS
Datos Planimétricos
Información RT
Diseño Proyecto Espacial
Desarrollo de Marca
Automatizaciones y Transferencias
Iteraciones Diseño
Imágenes y Vídeos
Package and Online Distribution""")
entwine = Entwine(Branch00="s", Branch02="s", Branch03="s", FlattenInputs=True)
entwine_2 = Entwine(Branch00="PC", Branch02="PC", FlattenInputs=True)
entwine_3 = Entwine(Branch00="m", Branch01="m", Branch02="m", Branch04="m", Branch06="m", Branch010="m", Branch011="m", FlattenInputs=True)
entwine_4 = Entwine(Branch00="GIS", Branch01="GIS", Branch02="GIS", Branch04="GIS", Branch06="GIS", Branch011="GIS", FlattenInputs=True)
entwine_5 = Entwine(
    Branch01="BIM",
    Branch02="BIM",
    Branch04="BIM",
    Branch08="BIM",
    Branch09="BIM",
    Branch010="BIM",
    Branch011="BIM",
    FlattenInputs=True)
entwine_6 = Entwine(
    Branch00="l",
    Branch01="l",
    Branch02="l",
    Branch04="l",
    Branch05="l",
    Branch06="l",
    Branch07="l",
    Branch08="l",
    Branch09="l",
    Branch010="l",
    Branch011="l",
    FlattenInputs=True)
merge = Merge(Data1=entwine, Data2=entwine_3, Data3=entwine_6)
entwine_7 = Entwine(
    Branch01="VR",
    Branch02="VR",
    Branch03="VR",
    Branch04="VR",
    Branch05="VR",
    Branch06="VR",
    Branch07="VR",
    Branch08="VR",
    Branch09="VR",
    Branch010="VR",
    Branch011="VR",
    FlattenInputs=True)
merge_2 = Merge(Data1=entwine_2, Data2=entwine_4, Data3=entwine_5, Data4=entwine_7)
tstat = TreeStatistics(Tree=merge_2)  # -> Paths, Length, Count
tstat_2 = TreeStatistics(Tree=merge)  # -> Paths, Length, Count
tstat_3 = TreeStatistics(Tree=merge_2)  # -> Paths, Length, Count
dup = DuplicateData(Data=graft(panel), Number=graft(tstat.Length), Order=True)
dup_2 = DuplicateData(Data=merge_2, Number=graft(tstat_2.Length), Order=True)  # -> simplify(Data)
dup_3 = DuplicateData(Data=dup, Number=graft(tstat_2.Length), Order=True)  # -> simplify(Data)
dup_4 = DuplicateData(Data=merge, Number=graft(tstat_3.Length), Order=True)  # -> simplify(Data)
panel_2 = Panel(dup)
panel_3 = Panel(dup_3)
panel_4 = Panel(merge_2)
panel_5 = Panel(dup_2)
panel_6 = Panel(dup_4)
concat = Concatenate(FragmentA="<td>", FragmentC=panel_5, FragmentB="</td>")
concat_2 = Concatenate(FragmentA="<td>", FragmentC=panel_6, FragmentB="</td>")
concat_3 = Concatenate(FragmentA="<td>", FragmentC=panel_3, FragmentB="</td>")
merge_3 = Merge(Data1=graft(concat_3), Data2=graft(concat), Data3=graft(concat_2))
join = TextJoin(Text=merge_3)
concat_4 = Concatenate(FragmentA="<tr>", FragmentC=join, FragmentB="</tr>")
join_2 = TextJoin(Text=flatten(concat_4))
panel_7 = Panel(join_2)
